# Grasshopper definition parametric_lca.gh (Grasshopper 1.0.9)

materialpropertymass = Python3Script(name="Clay Brick")  # -> out, material_property; inputs name: String
# ---------- materialpropertymass: Python ----------
from pod_lca_buildings_tool.material_properties import material_property_mass_from_idf

material_property = material_property_mass_from_idf(name)
# ---------- end materialpropertymass ----------
quantity = Python3Script(value=Slider(100, range=0..100), unit="m")  # -> out, quantity; inputs unit: String
# ---------- quantity: Python ----------
quantity_from_value_unit(value, unit)
# ---------- end quantity ----------
layer = Python3Script(material_property=materialpropertymass.material_property)  # -> out, a; unedited script template
panel = Panel(quantity.quantity)
